# Grasshopper definition flatten_kangeroo.gh (Grasshopper 1.0.7)
# plug-ins: LunchBox, Kangaroo2 Components

srf = Surface(<surface referenced from the Rhino model>)
edges = BrepEdges(Brep=srf)  # -> Naked, Interior, NonManifold
graft = GraftTree(Tree=edges.Naked, IncludeEmptyLists=True, IncludeNullItems=True)
hex = HexagonCells(Surface=srf, UDivisions=Slider(12, range=0..100), VDivisions=Slider(13, range=0..100), TParameter=0.25)  # -> HexagonCells, Centers
explode = Explode(Curve=hex.HexagonCells, Recursive=True)  # -> flatten(Segments), Vertices
cp = ControlPoints(Curve=hex.HexagonCells)  # -> Points, Weights, Knots
dupln = RemoveDuplicateLines(Lines=explode.Segments, Tolerance=0.01)
flatten = FlattenTree(Tree=cp.Points, Path="{0}")
number_slider = Slider(1, range=0..1)
duppt = RemoveDuplicatePts(Points=flatten, Tolerance=0.01)
crv_cp = CurveClosestPoint(Point=duppt, Curve=graft)  # -> Point, Parameter, Distance
length_line = LengthLine(Line=dupln, Strength=Slider(210, range=0..1000))
coplanar = CoPlanar(Points=cp.Points, Strength=Slider(980, range=0..1000))
equals = Equality(FirstNumber=crv_cp.Distance, SecondNumber=0)  # -> Equality, Inequality
cull = CullPattern(List=crv_cp.Point, CullPattern=equals.Equality)
oncurve = OnCurve(Points=cull, Curve=graft, Strength=Slider(300, range=0..1000))
solver = Solver(GoalObjects=flatten([length_line, coplanar, oncurve]), Reset=Button(), Threshold=1e-15, Tolerance=0.01, On=Toggle(False))  # -> I, V, O
crv = Curve(solver.O)
